# Grasshopper definition R-values V2.gh (Grasshopper 1.0.7)

# R-Values
# Measuring Resilient Communities
# CAADRIA
# last update: 5 Nov 2021
centre = Point(<point referenced from the Rhino model>)
educat = Point([<point referenced from the Rhino model> x1690])
trasnsp = Point([<point referenced from the Rhino model> x5000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])
entert = Point([<point referenced from the Rhino model> x3926])
ln = Line(StartPoint=centre, EndPoint=educat)
dist = Distance(PointA=centre, PointB=educat)
dist_2 = Distance(PointA=centre, PointB=trasnsp)
dist_3 = Distance(PointA=centre, PointB=entert)

# ---- group: Distances from Centre in Km
panel = Panel(dist_2)
panel_2 = Panel(dist)
panel_3 = Panel(dist_3)

# ----
python = GhPythonScript(distance=panel_2)  # -> out, a; inputs distance: Int32
# ---------- python: Python ----------
__author__ = "sc13adx"
__version__ = "2021.04.15"

import rhinoscriptsyntax as rs
"""hospitals"""

x = distance 

if x <=1.6:
    a = 1
elif x >1.6 and x<=2.4:
    a = 0.75
elif x > 2.4 and x<=8:
    a = 0.5
else:
    a = 0.25
# ---------- end python ----------
python_2 = GhPythonScript(distance=panel)  # -> a; inputs distance: Int32
# ---------- python_2: Python ----------
__author__ = "sc13adx"
__version__ = "2021.04.15"

import rhinoscriptsyntax as rs
"""hospitals"""

x = distance 

if x <=12.5:
    a = 1
elif x >12.5 and x<=25:
    a = 0.50
else:
    a = 0.25
# ---------- end python_2 ----------
python_3 = GhPythonScript(distance=panel_3)  # -> out, a; inputs distance: Int32
# ---------- python_3: Python ----------
__author__ = "sc13adx"
__version__ = "2021.04.15"

import rhinoscriptsyntax as rs

x = distance 

if x <=1.6:
    a = 1
elif x >1.6 and x<=2.4:
    a = 0.75
elif x > 2.4 and x<=8:
    a = 0.5
else:
    a = 0.25
# ---------- end python_3 ----------

# ---- group: Gamma Coefficient
panel_4 = Panel(python_2)
panel_5 = Panel(python.a)
panel_6 = Panel(python_3.a)

# ----
multiplication = Multiplication(A=panel_2, B=panel_5)
multiplication_2 = Multiplication(A=panel, B=panel_4)
multiplication_3 = Multiplication(A=panel_3, B=panel_6)

# ---- group: Resilience Values (to be summated)
panel_7 = Panel(multiplication)
panel_8 = Panel(multiplication_2)
panel_9 = Panel(multiplication_3)

# ----
ma = MassAddition(Input=panel_7)  # -> Result, PartialResults
lng = ListLength(List=ma.PartialResults)
ma_2 = MassAddition(Input=panel_8)  # -> Result, PartialResults
lng_2 = ListLength(List=ma_2.PartialResults)
ma_3 = MassAddition(Input=panel_9)  # -> Result, PartialResults
lng_3 = ListLength(List=ma_3.PartialResults)
division = Division(A=ma.Result, B=lng)
division_2 = Division(A=ma_2.Result, B=lng_2)
division_3 = Division(A=ma_3.Result, B=lng_3)

# ---- group: Resilience Value R (educ)
panel_10 = Panel(division)

# ---- group: Resilience Value R (transp)
panel_11 = Panel(division_2)

# ---- group: Resilience Value R (Entert)
panel_12 = Panel(division_3)

# ----
merge = Merge(Data1=panel_10, Data2=panel_11, Data3=panel_12)
ma_4 = MassAddition(Input=merge)  # -> Result, PartialResults
lng_4 = ListLength(List=merge)
division_4 = Division(A=ma_4.Result, B=lng_4)

# ---- group: Total Resilience Value R
# London 4.82
# Cairo 5.89
# Moscow 5.78
# Munich 14.14
# Toronto 4.69
# Seattle 7.56
# Delhi 4.92
# Singapore 4.53
# Melbourne 6.70
# Rio 6.70
# Pittsburgh 6.55
# Beijing 7.39
# Buenos Aires 4.06
# Stockholm 3.92
# Tokyo 6.97
panel_13 = Panel(division_4)
